# Dynamo graph Dynamo Test.dyn (Dynamo 2.11.0.4533)

file_path = Filename("D:\KITURI\JAva\Projects\Dynamo\Nodes.xlsx")
file_from_path = FileObject()  # unwired: path
string = StringInput("Foaie1")
importExcel = Data.ImportExcel(file=file_from_path, sheetName=string)
transpose = List.Transpose(lists=importExcel)

# group: Nodes
nodeNumber = Python(IN[0]=transpose)  # CPython3
# ---------- nodeNumber.python (14 lines) ----------
# Load the Python Standard and DesignScript Libraries
import sys
import clr
clr.AddReference('ProtoGeometry')
from Autodesk.DesignScript.Geometry import *

# The inputs to this node will be stored as a list in the IN variables.
dataEnteringNode = IN

# Place your code below this line
for x in range(len(IN)): 
    y =IN[x][0]
# Assign your output to the OUT variable.
OUT = y
# ----------------------------------------
nodeX = Python(IN[0]=transpose)  # CPython3
# ---------- nodeX.python (14 lines) ----------
# Load the Python Standard and DesignScript Libraries
import sys
import clr
clr.AddReference('ProtoGeometry')
from Autodesk.DesignScript.Geometry import *

# The inputs to this node will be stored as a list in the IN variables.
dataEnteringNode = IN

# Place your code below this line
for x in range(len(IN)): 
    y =IN[x][1]
# Assign your output to the OUT variable.
OUT = y
# ----------------------------------------
nodeY = Python(IN[0]=transpose)  # CPython3
# ---------- nodeY.python (14 lines) ----------
# Load the Python Standard and DesignScript Libraries
import sys
import clr
clr.AddReference('ProtoGeometry')
from Autodesk.DesignScript.Geometry import *

# The inputs to this node will be stored as a list in the IN variables.
dataEnteringNode = IN

# Place your code below this line
for x in range(len(IN)): 
    y =IN[x][2]
# Assign your output to the OUT variable.
OUT = y
# ----------------------------------------
nodeZ = Python(IN[0]=transpose)  # CPython3
# ---------- nodeZ.python (14 lines) ----------
# Load the Python Standard and DesignScript Libraries
import sys
import clr
clr.AddReference('ProtoGeometry')
from Autodesk.DesignScript.Geometry import *

# The inputs to this node will be stored as a list in the IN variables.
dataEnteringNode = IN

# Place your code below this line
for x in range(len(IN)): 
    y =IN[x][3]
#    output to the OUT variable.
OUT = y
# ----------------------------------------

byCoordinates = Point.ByCoordinates(x=nodeX, y=nodeY, z=nodeZ)
file_path_2 = Filename("Start\structure.py")
readText = FileSystem.ReadText(file=file_path_2)
lista_manuala_dimensiuni = CodeBlock()  # "Lista manuala dimensiuni relative"
# ---------- lista_manuala_dimensiuni.designscript (6 lines) ----------
//list of X bays
OUT[0]=[1.5,5,5,5,1.5];
//list of Y bays
OUT[1]=[1.5,4,5,4,5,4.5,1.5];
//list of levels
OUT[2]=[2.85,2.85,2.85,2.85,2.85,2.85,1.00];
# ----------------------------------------
python_script = Python(IN[0]=lista_manuala_dimensiuni.out0, IN[1]=lista_manuala_dimensiuni.out1, IN[2]=lista_manuala_dimensiuni.out2)  # CPython3
# ---------- python_script.python (31 lines) ----------
# Load the Python Standard and DesignScript Libraries
import sys
import clr
clr.AddReference('ProtoGeometry')
from Autodesk.DesignScript.Geometry import *

# The inputs to this node will be stored as a list in the IN variables.
dataEnteringNode = IN
nodes = [[],[],[]]
x = 0
nodes[0].append(x)
for i in IN[0]:
    x += i
    nodes[0].append(x)

y = 0
nodes[1].append(y)
for i in IN[1]:
    y += i
    nodes[1].append(y)

z = 0
nodes[2].append(z)
for i in IN[2]:
    z += i
    nodes[2].append(z)

# Place your code below this line

# Assign your output to the OUT variable.
OUT = nodes
# ----------------------------------------
lista_generata = CodeBlock(deschideri=python_script, travee=python_script, etaje=python_script) { OUT[0]=deschideri[0]; OUT[1]=travee[1]; OUT[2]=etaje[2]; }
python_script_from_string = PythonStringNode(script=readText, IN[0]=lista_generata.out0, IN[1]=lista_generata.out1, IN[2]=lista_generata.out2)  # CPython3

# group: X
number = DoubleInput(0)
number_slider_lungime = DoubleSlider(5, range=0..70 step 0.1)
number_slider_pas_deschidere = DoubleSlider(1, range=1..30 step 0.05)
range = Range(start=number, end=number_slider_lungime, step=number_slider_pas_deschidere)

# group: Y
number_2 = DoubleInput(0)
number_slider_latime = DoubleSlider(4, range=0..70 step 0.1)
number_slider_pas_travee = DoubleSlider(1, range=1..30 step 0.05)
range_2 = Range(start=number_2, end=number_slider_latime, step=number_slider_pas_travee)

# group: Z
number_3 = DoubleInput(0)
number_slider_inaltime = DoubleSlider(40, range=0..50 step 0.1)
number_slider_pas_nivel = DoubleSlider(2.85, range=1..12 step 0.05)
range_3 = Range(start=number_3, end=number_slider_inaltime, step=number_slider_pas_nivel)

lista_generata_dimensiuni = CodeBlock(deschideri=range, travee=range_2, etaje=range_3) { OUT[0]=deschideri; OUT[1]=travee; OUT[2]=etaje; }  # "Lista generata dimensiuni absolute"
lista_manuala_dimensiuni_2 = CodeBlock()  # "Lista manuala dimensiuni absolute"
# ---------- lista_manuala_dimensiuni_2.designscript (6 lines) ----------
//list of X bays
OUT[0]=[0,4,12,20,28,32,40,48,56,60];
//list of Y bays
OUT[1]=[0,4,12,20,28,32,40,48,56,60];
//list of levels
OUT[2]=[0,2.8,5.6,8.4,11.2];
# ----------------------------------------
