# Dynamo graph Test.dyn (Dynamo 2.11.0.4533)
# packages: Structural Analysis for Dynamo 2.11.0

file_path = Filename("D:\KITURI\JAva\Projects\Dynamo\Nodes.xlsx")
file_from_path = FileObject()  # unwired: path
string = StringInput("Foaie1")
importExcel = Data.ImportExcel(file=file_from_path, sheetName=string)
transpose = List.Transpose(lists=importExcel)

# group: Nodes
nodeNumber = Python(IN[0]=transpose)  # CPython3
# ---------- nodeNumber.python (14 lines) ----------
# Load the Python Standard and DesignScript Libraries
import sys
import clr
clr.AddReference('ProtoGeometry')
from Autodesk.DesignScript.Geometry import *

# The inputs to this node will be stored as a list in the IN variables.
dataEnteringNode = IN

# Place your code below this line
for x in range(len(IN)): 
    y =IN[x][0]
# Assign your output to the OUT variable.
OUT = y
# ----------------------------------------
nodeX = Python(IN[0]=transpose)  # CPython3
# ---------- nodeX.python (14 lines) ----------
# Load the Python Standard and DesignScript Libraries
import sys
import clr
clr.AddReference('ProtoGeometry')
from Autodesk.DesignScript.Geometry import *

# The inputs to this node will be stored as a list in the IN variables.
dataEnteringNode = IN

# Place your code below this line
for x in range(len(IN)): 
    y =IN[x][1]
# Assign your output to the OUT variable.
OUT = y
# ----------------------------------------
nodeY = Python(IN[0]=transpose)  # CPython3
# ---------- nodeY.python (14 lines) ----------
# Load the Python Standard and DesignScript Libraries
import sys
import clr
clr.AddReference('ProtoGeometry')
from Autodesk.DesignScript.Geometry import *

# The inputs to this node will be stored as a list in the IN variables.
dataEnteringNode = IN

# Place your code below this line
for x in range(len(IN)): 
    y =IN[x][2]
# Assign your output to the OUT variable.
OUT = y
# ----------------------------------------
nodeZ = Python(IN[0]=transpose)  # CPython3
# ---------- nodeZ.python (14 lines) ----------
# Load the Python Standard and DesignScript Libraries
import sys
import clr
clr.AddReference('ProtoGeometry')
from Autodesk.DesignScript.Geometry import *

# The inputs to this node will be stored as a list in the IN variables.
dataEnteringNode = IN

# Place your code below this line
for x in range(len(IN)): 
    y =IN[x][3]
#    output to the OUT variable.
OUT = y
# ----------------------------------------

byCoordinates = Point.ByCoordinates(x=nodeX, y=nodeY, z=nodeZ)
byPoint = DynamoSimulation.RSA.AnalyticalModel.AnalyticalNode.ByPoint()  # unwired: point

# group: X
number = DoubleInput(0)
number_slider_lungime = DoubleSlider(3, range=0..100 step 0.1)
number_slider_pas_deschidere = DoubleSlider(1, range=1..10 step 0.05)
range = Range(start=number, end=number_slider_lungime, step=number_slider_pas_deschidere)

# group: Y
number_2 = DoubleInput(0)
number_slider_latime = DoubleSlider(3, range=0..100 step 0.1)
number_slider_pas_travee = DoubleSlider(1, range=1..10 step 0.05)
range_2 = Range(start=number_2, end=number_slider_latime, step=number_slider_pas_travee)

# group: Z
number_3 = DoubleInput(0)
number_slider_inaltime = DoubleSlider(3, range=0..240 step 0.1)
number_slider_pas_nivel = DoubleSlider(1, range=1..10 step 0.05)
range_3 = Range(start=number_3, end=number_slider_inaltime, step=number_slider_pas_nivel)

python_script = Python(IN[0]=range, IN[1]=range_2, IN[2]=range_3)  # CPython3
# ---------- python_script.python (143 lines) ----------
# Load the Python Standard and DesignScript Libraries
import sys
import clr
clr.AddReference('ProtoGeometry')
from Autodesk.DesignScript.Geometry import *

# The inputs to this node will be stored as a list in the IN variables.
dataEnteringNode = IN
xCoords =[]
yCoords =[]
zCoords =[]
points =[]
# Generate X coords
for i in range(len(IN[1]*len(IN[2]))):
    for j in IN[0]:
        xCoords.append(j)
# Generate Y coords        
for k in range(len(IN[2])):
	for i in IN[1]:
		for j in range(len(IN[0])):
			yCoords.append(i)
# Generate Z coords			
for k in IN[2]:
	for j in range(len(IN[0])*len(IN[1])):
		zCoords.append(k)

#Generate points
for i in range(0,(len(IN[0])*len(IN[1])*len(IN[2]))):
    points.append(Point.ByCoordinates(xCoords[i], yCoords[i], zCoords[i]))



#Start points
startPoints = []

#X direction starting points
startStepX = len(IN[0])
startCounterX = 1
for i, val in enumerate(points[0:(len(points)-1)]):
    if startCounterX == (startStepX):
        startCounterX = 1
        continue
    startPoints.append(val)
    startCounterX += 1
#Y direction starting points
startStepY = len(IN[0])*len(IN[1])-len(IN[0])
finalStepY = len(IN[0])*len(IN[1]) 
lastPoints = len(points)-len(IN[0])
startCounterY = 1
for i, val in enumerate(points[0:lastPoints]):
    if (startCounterY > startStepY and startCounterY <= finalStepY):
        startCounterY += 1
        if startCounterY > finalStepY:
            startCounterY = 1
        continue    
    startPoints.append(val)
    startCounterY += 1
#Z direction starting points
lastPointsZ = len(IN[0])*len(IN[1])*len(IN[2])-len(IN[0])*len(IN[1])
for i, val in enumerate(points[0:lastPointsZ]):
    startPoints.append(val)

#End points
endPoints = []

#X direction ending points
endStepX = len(IN[0])
endCounterX = 1
for i, val in enumerate(points[1:len(points)]):
    if endCounterX == (endStepX):
        endCounterX = 1
        continue
    endPoints.append(val)
    endCounterX += 1
#Y direction ending points
endStepY = len(IN[0])*len(IN[1])-len(IN[0])
finalStepY = len(IN[0])*len(IN[1]) 
firstPoints = len(IN[0])
endCounterY = 1
for i, val in enumerate(points[firstPoints:len(points)]):
    if (endCounterY > startStepY and endCounterY <= finalStepY):
        endCounterY += 1
        if endCounterY > finalStepY:
            endCounterY = 1
        continue    
    endPoints.append(val)
    endCounterY += 1
#Z direction ending points
firstPointsZ = len(IN[0])*len(IN[1])
for i, val in enumerate(points[firstPointsZ:len(points)]):
    endPoints.append(val)


#Generate lines from points
lines = []

s = 0
e = 0
for i in range(0,len(startPoints)):
    lines.append(Line.ByStartPointEndPoint(startPoints[s], endPoints[e]))
    s += 1
    e += 1

#Generate horizontal surfaces
surfacesH = []
endLine = len(IN[0])
endColumn = len(IN[0])*len(IN[1])-len(IN[0])
endList = len(points)-len(IN[0])-1
lineCounter = 1
columnCounter = 1

for i, p in enumerate(points[0:endList]):


    if lineCounter < endLine and columnCounter < endColumn:
        if lineCounter > endLine:     
            lineCounter = 1
            columnCounter += 1
            continue
            
        if columnCounter > endColumn:     
            columnCounter = 1
            continue 

        if lineCounter <= endLine:
            lineCounter += 1
            
        if columnCounter <= endColumn :
            columnCounter += 1
    
       
    surfacesH.append(
    #Surface.ByPerimeterPoints(
    [
    points[i],
    points[i+1],
    points[i+len(IN[0])+1],
    points[i+len(IN[0])]
    ]
   # )
    )
# Assign your output to the OUT variable.
OUT = [points, lines, surfacesH]
# ----------------------------------------
code_block = CodeBlock(input=python_script)
# ---------- code_block.designscript (6 lines) ----------
//points
input[0];
//lines
input[1];
//surfaces
//output[2];
# ----------------------------------------
watch_3d = Watch3D(python_script)
byPerimeterPoints = Surface.ByPerimeterPoints()  # unwired: points
code_block_2 = CodeBlock {  }
